% Simulink data dictionary Data.sldd

BoneDensity_kgm3 = 1500
LegThickness_cm = 1
LegWidth_cm = 1
GravityVector_ms2 = [0 -9.81 0]
HipDampingCo_Nm_deg = 100
KneeDampingCo_Nm_deg = 0.1
HipAngleStart_rad = -1.570796
KneeActuatorSineAmplitude = 0.7853982
KneeActuatorSineFreq = 2
KneeActuatorSineBias = -1.570796
KneeSpringStiff_Nm_deg = 0.1
FootLength_cm = 20
FootThickness_cm = 1
FootWidth_cm = 8
LegLength_cm = 104